# Dynamo graph unit data.dyn (Dynamo 0.9.0.3067)

string = StringInput("b.Unit Token")
byName = Family.ByName(string)
types = Family.Types(byName)
string_2 = StringInput("Project_Name")
getParameterValueByName = Element.GetParameterValueByName(element=types, parameterName=string_2)
string_3 = StringInput("Matrix_Name")
getParameterValueByName_2 = Element.GetParameterValueByName(element=types, parameterName=string_3)
string_4 = StringInput("Area")
getParameterValueByName_3 = Element.GetParameterValueByName(element=types, parameterName=string_4)
string_5 = StringInput("Bedrooms")
getParameterValueByName_4 = Element.GetParameterValueByName(element=types, parameterName=string_5)
string_6 = StringInput("Baths")
getParameterValueByName_5 = Element.GetParameterValueByName(element=types, parameterName=string_6)
string_7 = StringInput("Den")
getParameterValueByName_6 = Element.GetParameterValueByName(element=types, parameterName=string_7)
all_elements_of_family_type = ElementsOfFamilyType(types)
string_8 = StringInput("Level")
getParameterValueByName_7 = Element.GetParameterValueByName(element=all_elements_of_family_type, parameterName=string_8)
string_9 = StringInput("Name")
getParameterValueByName_8 = Element.GetParameterValueByName(element=getParameterValueByName_7, parameterName=string_9)
flatten = Flatten(getParameterValueByName_8)
uniqueItems = List.UniqueItems(flatten)
sort = List.Sort(uniqueItems)
allIndicesOf = List.AllIndicesOf(item=sort)
map = List.Map(list=getParameterValueByName_8, f_x=allIndicesOf)
count = List.Count()
map_2 = List.Map(f_x=count)
map_3 = List.Map(list=map, f_x=map_2)
create = List.Create(getParameterValueByName, getParameterValueByName_2, getParameterValueByName_3, getParameterValueByName_4, getParameterValueByName_5, getParameterValueByName_6, map_3)
transpose = List.Transpose(create)
categories = Categories("Levels")
all_elements_of_category = ElementsOfCategory(categories)
string_10 = StringInput("Name")
getParameterValueByName_9 = Element.GetParameterValueByName(element=all_elements_of_category, parameterName=string_10)
firstItem = List.FirstItem()
